% Simulink data dictionary dd_ecu_circuity.sldd

cstNomThrsGateSrsVolt = Simulink.Parameter(2.6)
cstIntgDiodFrwdCurrMap = Simulink.Parameter([0.01 0.05 0.1 1 20 90 180 220; 0.5 4 20 55 100 170 200 220])
cstIntgDiodJuncTempVect = Simulink.Parameter([25 175])
cstIntgDiodFrwdVoltVect = Simulink.Parameter([0.4 0.5 0.6 0.7 0.8 0.9 1 1.1])
cstIntgDiodRevRcvrTime = Simulink.Parameter(3.5e-8)
cstIntgDiodJuncCpct = Simulink.Parameter(2.9e-11)
cstIntgDiodOffCndc = Simulink.Parameter(1.0e-8)
cstIntgDiodCurrChngRate = Simulink.Parameter(-100)
cstDrnSrcCurrVect = Simulink.Parameter([0 100 280])
cstJuncTempVect = Simulink.Parameter([25 160])
cstDrnSrcVoltMap = Simulink.Parameter([0 0.1786 0.5; 0 0.1029 0.288])
cstOffStatCndc = Simulink.Parameter(1.375e-7)  % Given that off conductance wrt junction temperature is 25 Ohm^-1 at 25°C and 250 Ohm^-1 at 125°C, off-state conductance is computed as average value.
cstSwtcLossDrnSrcCurrVect = Simulink.Parameter([10 30 70 100])
cstSwtcLossJuncTempVect = Simulink.Parameter([25 75 125])
cstTurnOnSwtcLossPwr = Simulink.Parameter([0.016 0.048 0.112 0.16; 0.016 0.0528 0.1232 0.176; 0.0192 0.0576 0.1344 0.192])
cstAvrgSwtcFreq = Simulink.Parameter(16000)
cstTurnOffSwtcLossPwr = Simulink.Parameter([0.034 0.102 0.238 0.34; 0.034 0.1122 0.2618 0.374; 0.0408 0.1224 0.2856 0.408])
cstSwtcLossOffStatVolt = Simulink.Parameter(20)
cstJuncThrmMass = Simulink.Parameter(0.05)
cstIntgDiodInitFrwdCurr = Simulink.Parameter(50)
cstIntgDiodPeakRevCurr = Simulink.Parameter(-0.57)
cstShntRstn = Simulink.Parameter(0.001)
cstInvtMdlSampTime = Simulink.Parameter(5.0e-8)
cstChrgCrctSrsCpcrRstn = Simulink.Parameter(0.0001)
cstChrgCrctPrllCpcrRstn = Simulink.Parameter(0.0001)
cstChrgCrctPrllRstn = Simulink.Parameter(100000)
cstTrmnCrctXRstn = Simulink.Parameter(2)
cstTrmnCrctYRstn = Simulink.Parameter(2)
cstTrmnCrctXCpcrRstn = Simulink.Parameter(1.0e-6)
cstTrmnCrctYCpcrRstn = Simulink.Parameter(1.0e-6)
cstTrmnCrctYCpct = Simulink.Parameter(1.0e-9)
cstTrmnCrctZRstn = Simulink.Parameter(2)
cstTrmnCrctZCpct = Simulink.Parameter(1.0e-9)
cstTrmnCrctZCpcrRstn = Simulink.Parameter(1.0e-6)
cstShntCpcrRstn = Simulink.Parameter(0.0001)
cstShntGrndCpcrRstn = Simulink.Parameter(0.0001)
cstSplyCrctIndcRstn = Simulink.Parameter(0.00166)
cstSplyCrctPosCpcrRstn = Simulink.Parameter(0.01)
cstSplyCrctGrndCpcrRstn = Simulink.Parameter(0.0001)
cstSplyCrctNegCpcrRstn = Simulink.Parameter(0.004)
cstTrmnCrctXCpct = Simulink.Parameter(1.0e-9)
cstShntFiltRstn = Simulink.Parameter(15)
cstDrnPhsCpct = Simulink.Parameter(1.0e-8)
cstDrnPhsCpcrRstn = Simulink.Parameter(0.0001)
cstDrnGrndCpct = Simulink.Parameter(2.0e-7)
cstDrnGrndCpcrRstn = Simulink.Parameter(0.0001)
cstPhsGrndCpcrRstn = Simulink.Parameter(0.0001)
cstPhsSrcCpct = Simulink.Parameter(1.0e-8)
cstPhsSrcCpcrRstn = Simulink.Parameter(0.0001)
cstSplyCrctPosCpct = Simulink.Parameter(0.00066)
cstSplyCrctNegCpct = Simulink.Parameter(0.00099)
cstSplyCrctIndc = Simulink.Parameter(4.7e-7)
cstSplyCrctGrndRstn = Simulink.Parameter(1000)
cstSplyCrctGrndCpct = Simulink.Parameter(4.7e-10)
cstGateRstn = Simulink.Parameter(20)
cstChrgCrctPrllCpct = Simulink.Parameter(6.8e-9)
cstChrgCrctSrsCpct = Simulink.Parameter(4.7e-10)
cstTrmnCrctXDiodFrwdCurrVect = Simulink.Parameter([0.001 0.15])
cstTrmnCrctXDiodFrwdVoltVect = Simulink.Parameter([0.715 1.25])
cstTrmnCrctYDiodFrwdCurrVect = Simulink.Parameter([0.001 0.15])
cstTrmnCrctYDiodFrwdVoltVect = Simulink.Parameter([0.715 1.25])
cstTrmnCrctZDiodFrwdCurrVect = Simulink.Parameter([0.001 0.15])
cstTrmnCrctZDiodFrwdVoltVect = Simulink.Parameter([0.715 1.25])
cstTrmnCrctSrcDiodFrwdCurrVect = Simulink.Parameter([0.001 0.15])
cstTrmnCrctSrcDiodFrwdVoltVect = Simulink.Parameter([0.715 1.25])
cstPhsGrndCpct = Simulink.Parameter(5.0e-9)
cstShntCpct = Simulink.Parameter(1.0e-8)
cstShntGrndCpct = Simulink.Parameter(6.8e-9)

cstNChnlMsftDrnSrcCurrMap = Simulink.Parameter([0 0 0 0 0 0 0 0 0 0 0 0 0 0 0 0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
 -1.93e-21 4.02e-10 7.98e-10 1.19e-9 1.59e-9 1.99e-9 2.38e-9 2.78e-9 3.17e-9 3.57e-9 3.97e-9 4.37e-9 4.76e-9 5.15e-9 5.55e-9 5.95e-9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
 -3.83e-21 4.02e-10 7.98e-10 1.19e-9 1.59e-9 1.99e-9 2.38e-9 2.78e-9 3.17e-9 3.57e-9 3.97e-9 4.37e-9 4.76e-9 5.15e-9 5.55e-9 5.95e-9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
 -5.75e-21 4.02e-10 7.98e-10 1.19e-9 1.59e-9 1.99e-9 2.38e-9 2.78e-9 3.17e-9 3.57e-9 3.97e-9 4.37e-9 4.76e-9 5.15e-9 5.55e-9 5.95e-9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
 -7.72e-21 4.03e-10 7.99e-10 1.2e-9 1.59e-9 1.99e-9 2.38e-9 2.78e-9 3.18e-9 3.57e-9 3.97e-9 4.37e-9 4.76e-9 5.16e-9 5.55e-9 5.95e-9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
 -1.03e-20 4.09e-10 8.05e-10 1.2e-9 1.6e-9 1.99e-9 2.39e-9 2.78e-9 3.18e-9 3.58e-9 3.97e-9 4.37e-9 4.77e-9 5.16e-9 5.56e-9 5.95e-9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
 -1.8e-20 4.52e-10 8.49e-10 1.25e-9 1.64e-9 2.04e-9 2.44e-9 2.83e-9 3.23e-9 3.62e-9 4.02e-9 4.42e-9 4.81e-9 5.2e-9 5.6e-9 6.0e-9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
 -7.04e-20 8.26e-10 1.18e-9 1.58e-9 1.98e-9 2.37e-9 2.77e-9 3.19e-9 3.59e-9 3.98e-9 4.38e-9 4.78e-9 5.18e-9 5.57e-9 5.97e-9 6.36e-9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
 -5.01e-19 3.48e-9 4.14e-9 4.75e-9 5.39e-9 6.03e-9 6.67e-9 7.3e-9 7.93e-9 8.55e-9 9.17e-9 9.79e-9 1.04e-8 1.1e-8 1.16e-8 1.22e-8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
 -4.09e-18 2.34e-8 2.56e-8 2.79e-8 3.01e-8 3.22e-8 3.44e-8 3.66e-8 3.87e-8 4.08e-8 4.29e-8 4.49e-8 4.75e-8 4.95e-8 5.15e-8 5.38e-8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 ])

cstNChnlMsftDrnSrcVoltVect = Simulink.Parameter([0 0.2 0.4 0.6 0.8 1 1.2 1.4 1.6 1.8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 16])
cstNChnlMsftGateSrcVoltVect = Simulink.Parameter([0 0.2 0.4 0.6 0.8 1 1.2 1.4 1.6 1.8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 14.6])
cstNChnlMsftCpctDrnVoltVect = Simulink.Parameter([0 10 20])
cstNChnlMsftOutpCpctVect = Simulink.Parameter([750 577 577])
cstNChnlMsftRvrsCpctVect = Simulink.Parameter([44 29 29])
cstNChnlMsftInpCpctVect = Simulink.Parameter([2421 1862 1862])
cstNChnlMsftDiodFrwdVoltVect = Simulink.Parameter([0 0.2 0.4 0.6 0.8 1])
cstNChnlMsftDiodFrwdCurrVect = Simulink.Parameter([0 8.79e-9 1.27e-5 0.0193 19.2 237])
cstSpicInvtMdlSampTime = Simulink.Parameter(1.0e-9)
cstMoftExtRstn = Simulink.Parameter(47)