% Simulink data dictionary dd_motor_parameter.sldd

parMotRtrInrt = Simulink.Parameter(1.652e-5)
parMotTorsViscDamp = Simulink.Parameter(7.957747e-05)
parGmrSensAngErrInpData = Simulink.Parameter([0; 1; 2; 3; 4; 5; 6; 7; 8; 9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 360], DataType="double")
parGmrSensAngErrLktData = Simulink.Parameter([-0.05; -0.05; -0.05; -0.04; -0.04; -0.04; -0.03; -0.03; -0.03; -0.03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 -0.05], DataType="double")
parMotMdlMagTempCoef = -0.0012
parMotRstnTempCoef = 0.00393

MOT_TYPE = enum(DefaultValue="DELTA")
  DELTA = 0
  STAR = 1

Mag_Temp = reshape([-17.39513 -17.3951 -17.3951 -8.89713 0.5390437 10.31285 20.24762 30.1907 40.13229 50.07079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], 19, 12, 7)
parMotMdlPermMagFlux = 0.00165
parMotMdlDirIndc = 2.18e-5
parMotMdlQdrtIndc = 2.18e-5
parMotMdlPhsRstn = 0.00524
parMotType = MOT_TYPE.STAR
parMotMdlPolePairNum = 5
cstMotorMdlSampTime = 6.25e-5