% Simulink data dictionary dd_power_pack.sldd
% references dd_ecu_circuity.sldd
% references dd_motor_parameter.sldd

Configuration = Simulink.ConfigSet(StartTime="0", StopTime="10", Solver="FixedStepAuto", ProdHWDeviceType="Intel->x86-64 (Windows64)", SystemTargetFile="grt.tlc", TargetLang="C")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
cstCurrSensAmplInpRstn = Simulink.Parameter(1300)